vi "index.gviweb"   [LabVIEW NXG 5.0.0]
panel controls:
  "TEXT": string = "INTRODUCE UN TEXTO"  # INTRODUCE UN TEXTO
panel indicators:
  "VIEW": string
  "LED": bool
  "HORA": timestamp
  "URL Image": string
diagram:
  # Place setup code before the loop. For example, perform initial data communication and wire the results into the loop.
  # Top-Level WebVIs usually contain a While Loop that never stops so that they can continue running as long as the web page is open in the user's web browser.
  while {
    Get Current Time() -> (current time=w1)
    $HORA <- w1
    $VIEW <- $TEXT
    Match Pattern(regular expression="PAYAN", string=$TEXT) -> (match substring=w2)
    Is Equal(x=w2, y="PAYAN") -> w3
    $LED <- w3
    Wait(time to wait=50)
    stop if FALSE
  }
